# Grasshopper definition prompt.gh (Grasshopper 1.0.8)

# ---- group: STEP1_GRASSHOPPER RECEIVES FROM FLASK
py3 = Python3Script(run=Toggle(False))  # -> out, prompt
# ---------- py3: Python ----------
import requests
import json

# Initialize the output variable
message = "The user preferences have not been generated yet"
print(message)

# Define the URL for the Flask server endpoint
url = 'http://127.0.0.1:5000/send_to_grasshopper'

# Get the response from the Flask server
message = requests.get(url)
response_data = message.json()  # Convert JSON string to a dictionary

# Extract the relevant part
received_message = response_data.get("response", "")  # Get the value of "response"
prompt = received_message.split(": ")[-1]  # Extract everything after ": "

# Print the output in the Grasshopper Python component
print(prompt)
# ---------- end py3 ----------
panel = Panel(py3.prompt)
panel_2 = Panel(py3.out)

# ---- group: STEP2_JSON FILE GENERATION
# i work from 8am to 4pm then i sit and read my book at 6pm to 8pm and do yoga at 9pm and i slpeep from 11pm until 7am
button = Button()
python_3_script = Python3Script(prompt=py3.prompt, run=button)  # -> out, hourly_metabolic_rates, hourly_activities, activities_json_str
# ---------- python_3_script: Python ----------
import requests
import json

url = "http://127.0.0.1:5000/extract_activities"

try:
    r = requests.post(url, json={"prompt": prompt})
    r.raise_for_status()
    result = r.json()
    print("RESULT FROM SERVER:", result)

    activities_data = result["activities"]

    hourly_metabolic_rates = list(activities_data["hourly_metabolic_rates"])
    hourly_activities = list(activities_data["hourly_activities"])
    activities_json_str = json.dumps(activities_data["activities_json"], indent=2)
except Exception as e:
    hourly_metabolic_rates = []
    hourly_activities = []
    activities_json_str = str(e)

a = hourly_metabolic_rates
b = hourly_activities
c = activities_json_str
# ---------- end python_3_script ----------
metabolic_rates = Panel(python_3_script.hourly_metabolic_rates)
panel_3 = Panel(python_3_script.activities_json_str)
activities = Panel(python_3_script.hourly_activities)
